# Grasshopper definition 231109_visiting_geometric_architecture.gh (Grasshopper 1.0.7)

# ---- group: パラメータ
ひねり度合い = Slider(2, range=0..5)
板間距離 = Slider(10, range=0..100)
板厚 = Slider(5, range=0..100)
腕の長さ = Slider(10, range=0..100)
板幅 = Slider(20, range=0..100)
板の枚数 = Slider(10, range=0..80)

# ---- group: True：ホテル阪神アネックスと同じパターン
_90度回転 = BooleanToggle(True)

# ----
controlpoints = Panel("40")
hight = Panel("1000")
multiplication = Multiplication(A=ひねり度合い, B="10")
pi = Pi(Factor=multiplication)
multiplication_2 = Multiplication(A=板幅, B="2")
range = Range(Domain=pi, Steps=controlpoints)
addition = Addition(A=板間距離, B=multiplication_2)
range_2 = Range(Domain=hight, Steps=controlpoints)
Z = UnitZ(Factor=range_2)
xy = XYPlane(Origin=Point(0, 0, 0))
division = Division(A=板幅, B=2)
division_2 = Division(A=板幅, B=2)
division_3 = Division(A=板厚, B=2)
pi_2 = Pi(Factor="0.5")
num = Number(range)
neg = Negative(Value=division)
tmatch = MatchText(Text=range, Pattern=pi_2, Case=True)
neg_2 = Negative(Value=division_2)
neg_3 = Negative(Value=division_3)
pt = PointPolar(BasePlane=xy, XYAngle=num, ZAngle=0, Offset=division)
pt_2 = PointPolar(BasePlane=xy, XYAngle=num, ZAngle=0, Offset=neg)
dispatch = Dispatch(List=Z, DispatchPattern=tmatch)  # -> ListA, ListB
dom = ConstructDomain(DomainStart=neg_2, DomainEnd=division_2)
dom_2 = ConstructDomain(DomainStart=neg_3, DomainEnd=division_3)
vec = Vector(dispatch.ListA)
vec_2 = Vector(vec)
vec_3 = Vector(Z)
rectangle = Rectangle(Plane=PlaneXY(0, 0, 0), XSize=dom, YSize=dom_2, Radius=0)  # -> Rectangle, Length
move = Move(Geometry=pt, Motion=vec_3)  # -> Geometry, Transform
move_2 = Move(Geometry=pt_2, Motion=vec_3)  # -> Geometry, Transform
move_3 = Move(Geometry=rectangle.Rectangle, Motion=vec)  # -> Geometry, Transform
# ひねり板a作成
intcrv = Interpolate(Vertices=move.Geometry, Degree=3, Periodic=False, KnotStyle=1)  # -> Curve, Length, Domain
intcrv_2 = Interpolate(Vertices=move_2.Geometry, Degree=3, Periodic=False, KnotStyle=1)  # -> Curve, Length, Domain
# ひねり板b作成
panel = Panel("0.5*pi")
rotate = Rotate(Geometry=move_3.Geometry, Angle=panel, Plane=PlaneXY(0, 0, 0))  # -> Geometry, Transform
swp2 = Sweep2(Rail1=intcrv.Curve, Rail2=intcrv_2.Curve, Sections=rectangle.Rectangle, SameHeight=False)
boundary = BoundarySurfaces(Edges=rotate.Geometry)
cap = CapHoles(Brep=swp2)
split = SplitBrep(Brep=cap, Cutter=boundary)
cap_2 = CapHoles(Brep=split)
volume = Volume(Geometry=cap_2)  # -> Volume, Centroid
sort = SortList(Keys=volume.Volume, ValuesA=cap_2)  # -> Keys, reverse(ValuesA)
item = ListItem(List=sort.ValuesA, Index=0, Wrap=True)
rotate_2 = Rotate(Geometry=item, Angle="0.5*pi", Plane=PlaneXY(0, 0, 0))  # -> Geometry, Transform
板a = Brep(cap)
板b = Brep(rotate_2.Geometry)
debrep = DeconstructBrep(Brep=板a)  # -> Faces, Edges, Vertices
debrep_2 = DeconstructBrep(Brep=板b)  # -> Faces, Edges, Vertices
腕の長さ_2 = Number(腕の長さ)
area = Area(Geometry=debrep.Faces)  # -> Area, Centroid
area_2 = Area(Geometry=debrep_2.Faces)  # -> Area, Centroid
Z_2 = UnitZ(Factor=腕の長さ_2)
vec_4 = Vector(vec_2)
# 腕取り付け
pdecon = Deconstruct(Point=area.Centroid)  # -> XComponent, YComponent, ZComponent
pdecon_2 = Deconstruct(Point=area_2.Centroid)  # -> XComponent, YComponent, ZComponent
addition_2 = Addition(A=Z_2, B=vec_4)
sort_2 = SortList(Keys=pdecon.ZComponent, ValuesA=debrep.Faces)  # -> Keys, ValuesA
sort_3 = SortList(Keys=pdecon_2.ZComponent, ValuesA=debrep_2.Faces)  # -> Keys, ValuesA
Z_3 = UnitZ(Factor=腕の長さ_2)
panel_2 = Panel("""0
-1""")
panel_3 = Panel("""0
-1""")
suirify = Suirify(addition_2)
item_2 = ListItem(List=sort_2.ValuesA, Index=panel_2, Wrap=True)
item_3 = ListItem(List=sort_3.ValuesA, Index=panel_3, Wrap=True)
neg_4 = Negative(Value=Z_3)
neg_5 = Negative(Value=suirify)
merge = Merge(Data1=neg_4, Data2=Z_3)
merge_2 = Merge(Data1=neg_5, Data2=Z_2)
extr = Extrude(Base=item_2, Direction=merge)
extr_2 = Extrude(Base=item_3, Direction=merge_2)
suirify_2 = Suirify(extr)
suirify_3 = Suirify(板a)
suirify_4 = Suirify(extr_2)
suirify_5 = Suirify(板b)
merge_3 = Merge(Data1=suirify_2, Data2=suirify_3)
merge_4 = Merge(Data1=suirify_4, Data2=suirify_5)
sunion = SolidUnion(Breps=merge_3)
sunion_2 = SolidUnion(Breps=merge_4)
板a_2 = Brep(sunion)
板b_2 = Brep(sunion_2)
# 回転
rotate_3 = Rotate(Geometry=板a_2, Angle="0.5*pi", Plane=PlaneXY(0, 0, 0))  # -> Geometry, Transform
rotate_4 = Rotate(Geometry=板b_2, Angle="0.5*pi", Plane=PlaneXY(0, 0, 0))  # -> Geometry, Transform
板間距離_2 = Number(addition)
板の枚数_2 = Number(板の枚数)
bool_90度回転 = Boolean(_90度回転)
板の枚数_3 = Number(板の枚数_2)
板間距離_3 = Number(板間距離_2)
filter = StreamFilter(Gate=bool_90度回転, Stream0=板b_2, Stream1=rotate_4.Geometry)
division_4 = Division(A=板の枚数_3, B=2)
division_5 = Division(A=板間距離_3, B=2)
X = UnitX(Factor=division_5)
# 複製＆上段部分追加
series = Series(Start=0, Step=板間距離_3, Count=division_4)
move_4 = Move(Geometry=filter, Motion=X)  # -> Geometry, Transform
X_2 = UnitX(Factor=series)
addition_3 = Addition(A=hight, B=腕の長さ)
move_5 = Move(Geometry=rotate_3.Geometry, Motion=X_2)  # -> Geometry, Transform
move_6 = Move(Geometry=move_4.Geometry, Motion=X_2)  # -> Geometry, Transform
pt_3 = ConstructPoint(XCoordinate=0, YCoordinate=0, ZCoordinate=addition_3)
merge_5 = Merge(Data1=move_5.Geometry, Data2=move_6.Geometry)
xy_2 = XYPlane(Origin=pt_3)
mirror = Mirror(Geometry=merge_5, Plane=xy_2)  # -> Geometry, Transform
bbox = BoundingBox(Content=merge_5, Plane=PlaneXY(0, 0, 0))  # -> Box, Box_2
volume_2 = Volume(Geometry=bbox.Box)  # -> Volume, Centroid
xy_3 = XYPlane(Origin=volume_2.Centroid)
xy_4 = XYPlane(Origin=pt_3)
mirror_2 = Mirror(Geometry=merge_5, Plane=xy_3)  # -> Geometry, Transform
mirror_3 = Mirror(Geometry=mirror_2.Geometry, Plane=xy_4)  # -> Geometry, Transform
entwine = Entwine(Branch00=merge_5, Branch01=mirror.Geometry, FlattenInputs=True)
entwine_2 = Entwine(Branch00=mirror_2.Geometry, Branch01=mirror_3.Geometry, FlattenInputs=True)
brep = Brep(entwine)
brep_2 = Brep(entwine_2)
swatch = ColourSwatch(SwatchColor=RGB(97, 97, 97))
swatch_2 = ColourSwatch(SwatchColor=RGB(255, 255, 255))

# ---- group: 分析パターン
preview = CustomPreview(Geometry=brep_2, Material=swatch)

# ---- group: ホテル阪神アネックス大阪と同じパターン
preview_2 = CustomPreview(Geometry=brep, Material=swatch)
